# Grasshopper definition January6th2020BuchmanChapter2.gh (Grasshopper 1.0.7)
# plug-ins: Bifocals

# ----
# torus
yz = YZPlane(Origin=Point(-1, 4, 0))
cir = Circle(Plane=yz, Radius=1)
arrpolar = PolarArray(Geometry=cir, Plane=PlaneXY(0, 0, 0), Count=10, Angle=6.283185307)  # -> Geometry, Transform
loft_opt = LoftOptions(Closed=True, Adjust=False, Rebuild=0, Refit=0, Type=0)
loft = Loft(Curves=arrpolar.Geometry, Options=loft_opt)

# ----
# ten points
dom = ConstructDomain(DomainStart=0, DomainEnd=1)
range = Range(Domain=dom, Steps=10)
range_2 = Range(Domain=dom, Steps=10)
pt = ConstructPoint(XCoordinate=range, YCoordinate=range_2, ZCoordinate=0)

# ----
# ten points grafted with
# equation x**2 - y**2
# Surface from Points node
number_slider = Slider(7, range=0..100)
number_slider_2 = Slider(12, range=0..100)
dom_2 = ConstructDomain(DomainStart=0, DomainEnd=1)
range_3 = Range(Domain=dom_2, Steps=number_slider)
range_4 = Range(Domain=dom_2, Steps=number_slider_2)  # -> graft(Range)
expression = Expression(x=range_3, y=range_4, Expression="x^2-y^2")
addition = Addition(A=number_slider_2, B="1")
pt_2 = ConstructPoint(XCoordinate=range_3, YCoordinate=range_4, ZCoordinate=expression)  # -> flatten(Point)
srfgrid = SurfaceFromPoints(Points=flatten(pt_2), UCount=addition, Interpolate=False)

# ----
# ten points grafted
dom_3 = ConstructDomain(DomainStart=0, DomainEnd=1)
range_5 = Range(Domain=dom_3, Steps=10)
range_6 = Range(Domain=dom_3, Steps=10)  # -> graft(Range)
pt_3 = ConstructPoint(XCoordinate=range_5, YCoordinate=range_6, ZCoordinate=0)

# ----
# flipping matrix
series = Series(Start=0, Step=1, Count=10)
pt_4 = ConstructPoint(XCoordinate=series, YCoordinate=graft(series), ZCoordinate=0)
flip = FlipMatrix(Data=pt_4)
intcrv = Interpolate(Vertices=flip, Degree=3, Periodic=False, KnotStyle=1)  # -> Curve, Length, Domain
intcrv_2 = Interpolate(Vertices=pt_4, Degree=3, Periodic=False, KnotStyle=1)  # -> Curve, Length, Domain

# ----
# flipping matrix on Torus
cir_2 = Circle(Plane=PlaneXY(0, 0, 0), Radius=Slider(2.91, range=0..10))
pframes = PerpFrames(Curve=cir_2, Count=10, Align=True)  # -> Frames, Parameters
cir_3 = Circle(Plane=pframes.Frames, Radius=1)
divide = DivideCurve(Curve=cir_3, Count=10, Kinks=False)  # -> Points, Tangents, Parameters
flip_2 = FlipMatrix(Data=divide.Points)
intcrv_3 = Interpolate(Vertices=divide.Points, Degree=3, Periodic=False, KnotStyle=1)  # -> Curve, Length, Domain
intcrv_4 = Interpolate(Vertices=flip_2, Degree=3, Periodic=False, KnotStyle=1)  # -> Curve, Length, Domain

# ----
# ten points grafted with
# equation x**2 - y**2
dom_4 = ConstructDomain(DomainStart=0, DomainEnd=1)
range_7 = Range(Domain=dom_4, Steps=10)
range_8 = Range(Domain=dom_4, Steps=10)  # -> graft(Range)
expression_2 = Expression(x=range_7, y=range_8, Expression="x^2-y^2")
pt_5 = ConstructPoint(XCoordinate=range_7, YCoordinate=range_8, ZCoordinate=expression_2)
